# Grasshopper definition hand landmarker.gh (Grasshopper 1.0.8)
# plug-ins: RhinoCodePluginGH, Squid (ShapeDiver Edition), BitmapPlus, ShapeDiverForGrasshopper

# ---- group: ignore
max_dim = Slider(1000, range=100..1000)
file_path = FilePath()

# ----
import_bitmap = ImportBitmap(URI=file_path, maximum_file_size=52428800, selected_file_formats="image/bmp,image/gif,image/jpeg,image/png,image/tif")  # -> Bitmap, Width, Height, Filename
readbitmap = Python3Script(bitmap=import_bitmap.Bitmap)  # -> out, image
# ---------- readbitmap: Python ----------
"""Grasshopper Script"""
import System
import Rhino
import Grasshopper
import os
import cv2 
import numpy as np
from System.Drawing import Bitmap
from System.IO import MemoryStream
from System.Drawing.Imaging import ImageFormat

DIRECTORY = os.path.dirname(ghdoc.Path)

class MyComponent(Grasshopper.Kernel.GH_ScriptInstance):
    def RunScript(self, bitmap):
        ms = MemoryStream()
        bitmap.Save(ms, ImageFormat.Jpeg)
        image_array = np.frombuffer(ms.ToArray(), dtype=np.uint8)
        image = cv2.imdecode(image_array, cv2.IMREAD_COLOR);
        return image
# ---------- end readbitmap ----------
resizeimagetomaxdimension = Python3Script(image=readbitmap.image, max_dim=max_dim)  # -> out, resized_image; inputs max_dim: Int32
# ---------- resizeimagetomaxdimension: Python ----------
"""Grasshopper Script"""
import System
import Rhino
import Grasshopper
import cv2

class MyComponent(Grasshopper.Kernel.GH_ScriptInstance):
    def RunScript(self, image, max_dim: int):
        w, h = image.shape[1], image.shape[0]
        scale = max_dim / max(w, h)
        image = cv2.resize(image, (int(w * scale), int(h * scale))) 
        return image
# ---------- end resizeimagetomaxdimension ----------
cornerdetector = Python3Script(image=resizeimagetomaxdimension.resized_image)  # -> out, corners
# ---------- cornerdetector: Python ----------
"""Grasshopper Script"""
import System
import Rhino
import Grasshopper
import Grasshopper.Kernel as gh
import cv2
import os
import numpy as np

class MyComponent(Grasshopper.Kernel.GH_ScriptInstance):
    def RunScript(self, image):
        gray = cv2.cvtColor(image, cv2.COLOR_BGR2GRAY)
        thresh = cv2.threshold(gray, 0, 255, cv2.THRESH_OTSU)[1]

        contours = cv2.findContours(thresh, cv2.RETR_EXTERNAL, cv2.CHAIN_APPROX_SIMPLE)
        
        if (contours == None):
            ghenv.Component.AddRuntimeMessage(gh.GH_RuntimeMessageLevel.Error, "find contour failed.")
            return

        c = max(contours[0], key=cv2.contourArea)
        contour_length = cv2.arcLength(c, True)

        approx_contours = None
        for e in np.linspace(0.01, 0.1, 10):
            approx = cv2.approxPolyDP(c, e * contour_length, True)
            if len(approx) <= 4:
                break
            approx_contours = approx

        if (approx_contours is None):
            ghenv.Component.AddRuntimeMessage(gh.GH_RuntimeMessageLevel.Error, "failed to approximate contour.")
            return

        hull = cv2.convexHull(approx_contours)

        if (len(hull) != 4):
            ghenv.Component.AddRuntimeMessage(gh.GH_RuntimeMessageLevel.Warning, "number of corners found is not 4.")

        sort_hull_x_desc = hull[np.argsort(hull[:,0,0])[::-1]]
        top_two_max_x = sort_hull_x_desc[:2]
        first_pt = top_two_max_x[np.argmin(top_two_max_x[:,0,1])]
        first_pt_index = np.where(hull == first_pt)[0][0]
        sorted_hull = np.roll(hull, -first_pt_index, axis = 0)

        # corners = []
        # for i in range(len(hull)):
        #     corners.append(Rhino.Geometry.Point3d(float(hull[i][0][0]), float(hull[i][0][1]), 0))

        return sorted_hull
# ---------- end cornerdetector ----------
writebitmap = Python3Script(image=resizeimagetomaxdimension.resized_image)  # -> out, bitmap
# ---------- writebitmap: Python ----------
"""Grasshopper Script Instance"""
import System
import Rhino
import Grasshopper
import cv2
import numpy as np
import clr
import os
from System.IO import MemoryStream
from System.Drawing import Bitmap


class MyComponent(Grasshopper.Kernel.GH_ScriptInstance):
    def RunScript(self, image):
        image_enc = cv2.imencode(".jpg", image)[1]
        image_bytes = image_enc.tobytes()
        ms = MemoryStream(image_bytes, True)
        bitmap = Bitmap(ms)
        return bitmap
# ---------- end writebitmap ----------

# ---- group: ignore
scale_factor = Slider(3, range=1..10)
panel = Panel("210")
panel_2 = Panel("297")
panel_3 = Panel("1")

# ----
quick_preview = QuickPreview(Bitmap=writebitmap.bitmap)
warpperspectivetocorners = Python3Script(image=resizeimagetomaxdimension.resized_image, corners=cornerdetector.corners)  # -> out, warp_image
# ---------- warpperspectivetocorners: Python ----------
"""Grasshopper Script"""
import System
import Rhino
import Grasshopper
import Grasshopper.Kernel as gh
import cv2
import numpy as np
import math


class MyComponent(Grasshopper.Kernel.GH_ScriptInstance):
    def RunScript(self, image, corners):
        if len(corners) != 4:
            ghenv.Component.AddRuntimeMessage(gh.GH_RuntimeMessageLevel.Error, "number of corners must be 4.")
            return

        input_corners = np.float32(corners)

        width, height = get_width_height(corners)

        output_corners = np.float32([[width, 0], [width, height], [0, height], [0, 0]])

        M = cv2.getPerspectiveTransform(input_corners, output_corners)
        warp_image = cv2.warpPerspective(image, M, (int(width), int(height)))

        return warp_image


def get_width_height(corners):
    p0 = corners[0]
    p1 = corners[1]
    p2 = corners[2]
    p3 = corners[3]

    d01 = math.sqrt((p1[0][0] - p0[0][0]) ** 2 + (p1[0][1] - p0[0][1]) ** 2)
    d12 = math.sqrt((p2[0][0] - p1[0][0]) ** 2 + (p2[0][1] - p1[0][1]) ** 2)
    d23 = math.sqrt((p3[0][0] - p2[0][0]) ** 2 + (p3[0][1] - p2[0][1]) ** 2)
    d30 = math.sqrt((p0[0][0] - p3[0][0]) ** 2 + (p0[0][1] - p3[0][1]) ** 2)

    width = (d30 + d12) / 2
    height = (d01 + d23) / 2

    print(width)
    print(height)
    return width, height
# ---------- end warpperspectivetocorners ----------

# ---- group: ignore
format = ValueList({"jpg", "png", "tiff", "bmp", "gif"}, selected="jpg")
panel_4 = Panel("output.jpg")

# ----
image_export_options = ImageExportOptions(Format=format, QualityLevel=100, N=False)

# ---- group: scale to A4
multiplication = Multiplication(A=panel, B=scale_factor)
multiplication_2 = Multiplication(A=panel_2, B=scale_factor)
resizeimage = Python3Script(image=warpperspectivetocorners.warp_image, width=multiplication, height=multiplication_2)  # -> out, resized_image; inputs width: Int32, height: Int32
# ---------- resizeimage: Python ----------
"""Grasshopper Script"""
import System
import Rhino
import Grasshopper
import cv2

class MyComponent(Grasshopper.Kernel.GH_ScriptInstance):
    def RunScript(self, image, width: int, height: int):
        resize_img = cv2.resize(image, (width, height))
        return resize_img
# ---------- end resizeimage ----------
division = Division(A=panel_3, B=scale_factor)

# ----
writebitmap_2 = Python3Script(image=resizeimage.resized_image)  # -> out, bitmap; same code as writebitmap
quick_preview_2 = QuickPreview(Bitmap=writebitmap_2.bitmap)
runhandlandmarker = Python3Script(img=resizeimage.resized_image)  # -> out, handedness, landmark_pts, annotated_img
#   port handedness: True if Right, False if Left
# ---------- runhandlandmarker: Python ----------
"""Grasshopper Script"""
# Mediapipe hand landmarker reference: https://ai.google.dev/edge/mediapipe/solutions/vision/hand_landmarker/index#models
# requirements: mediapipe
import System
import Rhino
import Grasshopper
import mediapipe as mp
from mediapipe.tasks import python
from mediapipe.tasks.python import vision
from mediapipe import solutions
from mediapipe.framework.formats import landmark_pb2
import numpy as np
import cv2
import os


DIRECTORY = os.path.dirname(ghdoc.Path)


class MyComponent(Grasshopper.Kernel.GH_ScriptInstance):
    def RunScript(self, img):
        return hand_landmarks(img)


def hand_landmarks(img):
    with solutions.hands.Hands(static_image_mode=True, max_num_hands=1) as detector:
        img = cv2.flip(img, 1)
        img_cvt = cv2.cvtColor(img, cv2.COLOR_RGB2BGR)
        detection_result = detector.process(img_cvt)

        hand_landmarks = detection_result.multi_hand_landmarks[0]
        handedness = detection_result.multi_handedness[0].classification[0].label

        points = []
        h, w, _ = img.shape
        for landmark in hand_landmarks.landmark:
            points.append(
                Rhino.Geometry.Point3d((1-landmark.x) * w, (1-landmark.y) * h, 0)
            )
        img = cv2.flip(img, 1)

        annotated_image = annotate_landmarks(img, hand_landmarks, handedness)

        return handedness == "Right", points, annotated_image


def annotate_landmarks(rgb_image, hand_landmarks, handedness) -> None:
    annotated_image = np.copy(rgb_image)

    # Draw the hand landmarks.
    hand_landmarks_proto = landmark_pb2.NormalizedLandmarkList()
    hand_landmarks_proto.landmark.extend(
        [
            landmark_pb2.NormalizedLandmark(x=1-landmark.x, y=landmark.y, z=landmark.z)
            for landmark in hand_landmarks.landmark
        ]
    )

    solutions.drawing_utils.draw_landmarks(
        annotated_image,
        hand_landmarks_proto,
        solutions.hands.HAND_CONNECTIONS,
        solutions.drawing_styles.get_default_hand_landmarks_style(),
        solutions.drawing_styles.get_default_hand_connections_style(),
    )

    # Get the top left corner of the detected hand's bounding box.
    height, width, _ = annotated_image.shape
    x_coordinates = [landmark.x for landmark in hand_landmarks.landmark]
    y_coordinates = [landmark.y for landmark in hand_landmarks.landmark]
    text_x = int(min(x_coordinates) * width)
    text_y = int(min(y_coordinates) * height) - 10

    # Draw handedness (left or right hand) on the image.
    cv2.putText(
        annotated_image,
        f"{handedness}",
        (text_x, text_y),
        cv2.FONT_HERSHEY_DUPLEX,
        1,
        (88, 205, 54),
        1,
        cv2.LINE_AA,
    )
    return annotated_image
# ---------- end runhandlandmarker ----------
writebitmap_3 = Python3Script(image=runhandlandmarker.annotated_img)  # -> out, bitmap; same code as writebitmap

# ---- group: scale to A4 (continued)
scale_nu = ScaleNU(Geometry=runhandlandmarker.landmark_pts, Plane=PlaneXY(0, 0, 0), ScaleX=division, ScaleY=division, ScaleZ=1)  # -> Geometry, Transform

# ---- group: display bitmap in viewport
save_bitmap = SaveBitmap(ImageBitmap=writebitmap_3.bitmap, Extension=0, Save=True)
import_image = ImportImage(File=save_bitmap)

# ----
quick_preview_3 = QuickPreview(Bitmap=writebitmap_3.bitmap)
download_export = DownloadExport(Data=writebitmap_3.bitmap, Options=image_export_options, Name=panel_4)
