# Grasshopper definition hand_landmark_hops.gh (Grasshopper 1.0.7)
# plug-ins: Hops, BitmapPlus, Heteroptera

file_path = FilePath()
bitmap_properties = BitmapProperties(Image=file_path)  # -> Boundary, Width, Height, HorizontalResolution, VerticalResolution, Format
hops = Hops(
    ImagePath=file_path,
    CacheResultsInMemory=False,
    CacheSolveResults=False,
    RemoteDefinitionLocation="http://localhost:5000/readimage",
    RemoteSolveVersion=(0, 1, 0),
    ShowInput_Enabled=False,
    ShowInput_Path=False,
    SynchronousSolve=True)
min_max = MinMax(Number=[bitmap_properties.Width, bitmap_properties.Height])  # -> Minimum, Maximum
division = Division(A=Slider(1000, range=100..1000), B=min_max.Maximum)
multiplication = Multiplication(A=division, B=bitmap_properties.Width)
multiplication_2 = Multiplication(A=division, B=bitmap_properties.Height)
hops_2 = Hops(
    EncodedImage=hops,
    Width=multiplication,
    Height=multiplication_2,
    CacheResultsInMemory=False,
    CacheSolveResults=False,
    RemoteDefinitionLocation="http://localhost:5000/resizeimage",
    RemoteSolveVersion=(0, 1, 0),
    ShowInput_Enabled=False,
    ShowInput_Path=False,
    SynchronousSolve=True)
hops_3 = Hops(
    EncodedImage=hops_2,
    CacheResultsInMemory=False,
    CacheSolveResults=False,
    RemoteDefinitionLocation="http://localhost:5000/cornerdetection",
    RemoteSolveVersion=(0, 1, 0),
    ShowInput_Enabled=False,
    ShowInput_Path=False,
    SynchronousSolve=True)
number_slider = Slider(3, range=0..10)
hops_4 = Hops(
    EncodedImage=hops_2,
    Corners=hops_3,
    CacheResultsInMemory=False,
    CacheSolveResults=False,
    RemoteDefinitionLocation="http://localhost:5000/warpperspective",
    RemoteSolveVersion=(0, 1, 0),
    ShowInput_Enabled=False,
    ShowInput_Path=False,
    SynchronousSolve=True)
multiplication_3 = Multiplication(A="210", B=number_slider)
multiplication_4 = Multiplication(A="297", B=number_slider)
hops_5 = Hops(
    EncodedImage=hops_4,
    Width=multiplication_3,
    Height=multiplication_4,
    CacheResultsInMemory=False,
    CacheSolveResults=False,
    RemoteDefinitionLocation="http://localhost:5000/resizeimage",
    RemoteSolveVersion=(0, 1, 0),
    ShowInput_Enabled=False,
    ShowInput_Path=False,
    SynchronousSolve=True)
hops_6 = Hops(
    EncodedImage=hops_5,
    CacheResultsInMemory=False,
    CacheSolveResults=False,
    RemoteDefinitionLocation="http://localhost:5000/handlandmark",
    RemoteSolveVersion=(0, 1, 0),
    ShowInput_Enabled=False,
    ShowInput_Path=False,
    SynchronousSolve=True)  # -> Handedness, Points, AnnotatedEncodedImage
division_2 = Division(A="1", B=number_slider)
hops_7 = Hops(
    EncodedImage=hops_6.AnnotatedEncodedImage,
    CacheResultsInMemory=False,
    CacheSolveResults=False,
    RemoteDefinitionLocation="http://localhost:5000/writeimage",
    RemoteSolveVersion=(0, 1, 0),
    ShowInput_Enabled=False,
    ShowInput_Path=False,
    SynchronousSolve=True)
scale_nu = ScaleNU(Geometry=hops_6.Points, Plane=PlaneXY(0, 0, 0), ScaleX=division_2, ScaleY=division_2, ScaleZ=1)  # -> Geometry, Transform
import_image = ImportImage(File=hops_7)
